# Grasshopper definition AGGREGATE.gh (Grasshopper 1.0.7)
# plug-ins: FileToScript

panel = Panel("BeaverComponent.cs")  # disabled
dir_type = ValueList({"desktop": 0, "documents": 1, "GH file path": 2, "C:": 3}, selected="GH file path")  # disabled
f_ghfilepath = GHFilePathInfo()  # -> F, P; disabled
# ---------- f_ghfilepath: C# ----------
                                      /*
    froGH - a sparse collection of (in)utilities for Grasshopper

    GH File and Path info

    code by Alessio Erioli

    froGH by Co-de-iT is licensed under a Creative Commons Attribution 4.0 International License.
    http://creativecommons.org/licenses/by/4.0/

    */

    initComp();

    GH_Document ghDoc = Grasshopper.Instances.ActiveCanvas.Document;

    int nameLen = ghDoc.DisplayName.TrimEnd('*').Length + 3; // +3 accounts for the '.gh' extension
    int fileLen = ghDoc.FilePath.TrimEnd('*').Length;

    F = ghDoc.DisplayName.TrimEnd('*');
    P = ghDoc.FilePath.Substring(0, fileLen - nameLen);
# ---------- f_ghfilepath: C# additional code ----------
  void initComp(){

    Component.Name = "GH File Path Info";
    Component.NickName = "f_GHFilePath";
    Component.Description = "Provides info on current Grasshopper Document file name and path\nUseful for exporting files with the same name as the gh file and in the same directory";
    Component.Params.Output[0].Name = "File Name";
    Component.Params.Output[0].Description = "Current GH file name";
    Component.Params.Output[1].Name = "File Path";
    Component.Params.Output[1].Description = "Current GH file path";
  }
# ---------- end f_ghfilepath ----------
panel_2 = Panel("Beaver\Beaver")  # disabled
panel_3 = Panel(f_ghfilepath.P)  # disabled
f_pathg = PathGenerator(type=dir_type, subDir=panel_2)  # -> dir; inputs type: Int32, subDir: String; disabled
# ---------- f_pathg: C# ----------
                           /*
    froGH - a sparse collection of (in)utilities for Grasshopper

    Path Generator
    code by Alessio Erioli - value list generation based on code by James Ramsden

    froGH by Co-de-iT is licensed under a Creative Commons Attribution 4.0 International License.
    http://creativecommons.org/licenses/by/4.0/

    */
    initComp();


    String S = "";
    String root = "";
    String end = "\\";
    String eol = Environment.NewLine;

    // __________________ autoList part __________________

    // variable for the list
    Grasshopper.Kernel.Special.GH_ValueList vList;
    // tries to cast input as list
    try{

      // if the list is not the first parameter then change Input[0] to the corresponding value
      vList = (Grasshopper.Kernel.Special.GH_ValueList) Component.Params.Input[0].Sources[0];
      // Print("value list connected");
      // check if the list must be created
      //if (vList.NickName != "dir type"){
      if (!vList.NickName.Equals("dir type")){
        vList.ClearData();
        vList.ListItems.Clear();
        vList.NickName = "dir type";
        var item1 = new Grasshopper.Kernel.Special.GH_ValueListItem("desktop", "0");
        var item2 = new Grasshopper.Kernel.Special.GH_ValueListItem("documents", "1");
        var item3 = new Grasshopper.Kernel.Special.GH_ValueListItem("GH file path", "2");
        var item4 = new Grasshopper.Kernel.Special.GH_ValueListItem("C:", "3");
        vList.ListItems.Add(item1);
        vList.ListItems.Add(item2);
        vList.ListItems.Add(item3);
        vList.ListItems.Add(item4);

        vList.ListItems[0].Value.CastTo(out type);
      }
    }
    catch{
      // handles anything that is not a value list
    }


    switch(type){
      case 0:
        root = Environment.GetFolderPath(Environment.SpecialFolder.Desktop) + end;
        S = "Desktop";
        break;
      case 1:
        root = Environment.GetFolderPath(Environment.SpecialFolder.MyDocuments) + end;
        S = "Documents";
        break;
      case 2:
        GH_Document ghDoc = owner.OnPingDocument();

        if (ghDoc.IsFilePathDefined)
        {
          int nameLen = ghDoc.DisplayName.TrimEnd('*').Length + 3; // +3 accounts for the '.gh' extension
          int fileLen = ghDoc.FilePath.TrimEnd('*').Length;

          //F = ghDoc.DisplayName.TrimEnd('*');
          root = ghDoc.FilePath.Substring(0, fileLen - nameLen);
          //root = gh_d.FilePath;
          S = "GH File path";
        }
        else
        {
          Print("No path defined. Saving to Desktop until then");
          root = Environment.GetFolderPath(Environment.SpecialFolder.Desktop);
          S = "Desktop";
        }
        break;
      case 3:
        root = "C:" + end;
        S = root + end;
        break;
    }
    dir = root + (subDir != null ? (subDir + end) : "");
    Component.Message = S;
# ---------- f_pathg: C# additional code ----------
  void initComp(){
    Component.Name = "Path Generator";
    Component.NickName = "f_PathG";
    Component.Description = "generates a path based on local direcories such as Desktop, Documents, GH file path";
    Component.Params.Input[0].Name = "dir type";
    Component.Params.Input[0].Description = "directory type: 0 desktop, 1 documents, 2 GH file path, 3 C:\nconnect a value list for automatic list generation";
    Component.Params.Input[1].Name = "custom subdir";
    Component.Params.Input[1].Description = "(optional) custom subdirectory";
  }
# ---------- end f_pathg ----------
concat = Concatenate(FragmentA=f_pathg, FragmentB=panel)  # disabled

panel_4 = Panel("D:\DESIGN BY DATA\COURSE\97_THESIS\AGGREGATE\BEAVER\BEAVER\BEAVER.cs")
number_slider = Slider(100, range=0..100, expression="x*3")
dom = ConstructDomain(DomainStart=Slider(0.03, range=0..1), DomainEnd=Slider(0.1, range=0..10))
dom_2 = ConstructDomain(DomainStart=Slider(0.7, range=0..1), DomainEnd=Slider(3.1, range=0..10))
dom_3 = ConstructDomain(DomainStart=Slider(0.03, range=0..1), DomainEnd=Slider(0.1, range=0..10))
random = Random(Range=dom, Number=Slider(100, range=0..100, expression="x*3"), Seed=Slider(3, range=0..10))  # -> flatten(Random)
random_2 = Random(Range=dom_2, Number=number_slider, Seed=2)  # -> flatten(Random)
random_3 = Random(Range=dom_3, Number=Slider(100, range=0..100, expression="x*3"), Seed=2)  # -> flatten(Random)
series = Series(Start=0, Step=1, Count=number_slider)
panel_5 = Panel(random_2)
path = FilePath(panel_4)
concat_2 = Concatenate(FragmentB=series)
pt = ConstructPoint(XCoordinate=0, YCoordinate=0, ZCoordinate=0)
c_script = CSharpScript(p=pt, id=series, l=random_2, w=random_3, t=random)  # -> out, A, B, C; inputs p: Point3d, id: Int32, l: Double, w: Double, t: Double
# ---------- c_script: C# ----------
        aggregate aggregate = new aggregate(_p, _id, _l, _w, _t);
        
        int aggId = aggregate.Id;
        A = aggId;
        B = aggregate;
# ---------- c_script: C# additional code ----------
 


    public class aggregate
    {
        //Fields 
        private Point3d agg_initPos;
        public Point3d InitPos
        {
            get { return agg_initPos; }
            set { agg_initPos = value; }
        }
        private string agg_name;
        public string Name
        {
            get { return agg_name; }
            set { agg_name = value; }
        }
        private int agg_Id;
        public int Id
        {
            get { return agg_Id; }
            set { agg_Id = value; }
        }
        private double agg_length;
        public double Length
        {
            get { return agg_length; }
            set { agg_length = value; }
        }
        private double agg_width;
        public double Width
        {
            get { return agg_width; }
            set { agg_width = value; }
        }
        private double agg_thickness;
        public double Thickness
        {
            get { return agg_thickness; }
            set { agg_thickness = value; }
        }
        private int agg_xFreedom;
        public int XFreedom
        {
            get { return agg_xFreedom; }
            set { agg_xFreedom = value; }
        }
        private int agg_yFreedom;
        public int YFreedom
        {
            get { return agg_yFreedom; }
            set { agg_yFreedom = value; }
        }
        private int agg_zFreedom;
        public int ZFreedom
        {
            get { return agg_zFreedom; }
            set { agg_zFreedom = value; }
        }
        private double agg_xPos;
        public double XPos
        {
            get { return agg_xPos; }
            set { agg_xPos = value; }
        }
        private double agg_yPos;
        public double YPos
        {
            get { return agg_yPos; }
            set { agg_yPos = value; }
        }
        private double agg_zPos;
        public double ZPos
        {
            get { return agg_zPos; }
            set { agg_zPos = value; }
        }

        //Constructor
        public aggregate()
        {

        }

        public aggregate(Point3d initPos, int id, double l, double w, double t)
        {
            this.InitPos = initPos;
            this.Id = id;
            this.Length = l;
            this.Width = w;
            this.Thickness = t;
        }

        //Methods


    }

    // utilities functions

    /// <summary>
    /// This Function maps a value from a source domain to a destination domain
    /// </summary>
    /// <param name="val">the value</param>
    /// <param name="fromMin">low value of source domain</param>
    /// <param name="fromMax">high value of source domain</param>
    /// <param name="toMin">low value of destination domain</param>
    /// <param name="toMax">high value of destination domain</param>
    /// <returns>the remapped value</returns>
    public double Map(double val, double fromMin, double fromMax, double toMin, double toMax)
    {
        return toMin + (val - fromMin) * (toMax - toMin) / (fromMax - fromMin);
    }

    public double Volume(double l, double w, double t)
    {
        return l * w * t;
    }

    public List<double> List(double item)
    {
        List<double> list = new List<double>();
        foreach (double i in item)
        {
            list.Add(i);
            return list;
        }
    }
# ---------- end c_script ----------
ftsv2 = FileToScriptV2(File=path)
panel_6 = Panel(random_3)
panel_7 = Panel(c_script.A)
panel_8 = Panel(random)
c_script_2 = CSharpScript(x=c_script.B, Reference="C:\Users\Matthieu\AppData\Roaming\Grasshopper\Libraries\BEAVER.dll")  # -> out, A
# ---------- c_script_2: C# usings ----------
//<custom using>
using BEAVER;
//</custom using>
# ---------- c_script_2: C# ----------
    A = x.Name;
# ---------- end c_script_2 ----------
panel_9 = Panel(c_script_2.out)
